vi "index.gviweb"   [LabVIEW NXG 3.1.0]
panel indicators:
  "Connected?": bool
  "RX Data": string
  "WebSockets URL": string
uses:
  WebApp::GetHostname.jsli::GetHostname
  NI::WebSockets::Close WebSocket.gvi
  NI::G Core::Error::Clear Error Cluster.gvi
  NI::WebSockets::Open WebSocket.gvi
  NI::WebSockets::Read String.gvi
diagram:
  call "GetHostname"() -> (return=w1, error out=w2)
  # Change this according to whether it's being hosted on the Pi (e.g. localhost) or you are accessing remotely (Pi IP address)
  Format Into String(formatString="ws://%s:6123", errIn=w2, w1) -> (outString=w3, errOut=w4)
  # Place setup code before the loop. For example, perform initial data communication and wire the results into the loop.
  $"WebSockets URL" <- w3
  # Top-Level WebVIs usually contain a While Loop that never stops so that they can continue running as long as the web page is open in the user's web browser.
  s1 = "Initialise"  # shift register
  s2 = uninitialised  # shift register
  while {
    case (s1) {
      frame "Initialise", Default {
        w5 = "Connecting"
        w6 = w4
        w7 = s2
      }
      frame "Connecting" {
        call "Close WebSocket.gvi"(websocket session in=s2, error in=w4) -> (error out=w8)
        call "Clear Error Cluster.gvi"(error in=w8) -> (error out=w9)
        call "Open WebSocket.gvi"(url=w3, error in=w9) -> (websocket session out=w7, error out=w6)
        Select(s=w6, t="Connecting", f="Read") -> w5
        Not(x=w6) -> w10
        $"Connected?" <- w10
        Wait(time to wait=250)
      }
      frame "Read" {
        call "Read String.gvi"(websocket session in=s2, timeout=1, error in=w4) -> (websocket session out=w7, string response=w11, error out=w6)
        Select(s=w6, t="Connecting", f="Read") -> w5
        $"RX Data" <- w11
      }
    }
    next s1 = w5
    next s2 = w7
    stop if FALSE
  }
